# Grasshopper definition sectiondrawer.gh (Grasshopper 0.9.76)
# plug-ins: Python Interpreter, Human UI

方向の目印 = Slider(10000, range=0..10000)
基点の目印 = Slider(1, range=0..1)
panel = Panel("""main
option""")

# ---- group: 切断線
crv = Curve()

# ----
launchwin = LaunchWindow(Show=Toggle(False), Name="Control Window", Width=370, Height=400, ChildStatus=1, EnableHorizScroll=False)
slider = CreateSlider(
    Slider=方向の目印,
    SnapValue=Slider(1000, range=0..1000),
    ShowBounds=False,
    showLabel=True,
    ShowTicks=False,
    ShowTooltip=False,
    ShowValLabel=True)
toggle = CreateToggle(Default=False, OnLabel=" ", OffLabel=" ")
button = CreateButton(ButtonName="次の切断線を設定する", ButtonStyle=0)
slider_2 = CreateSlider(
    Slider=基点の目印,
    SnapValue=Slider(0.1, range=0..0.1),
    ShowBounds=False,
    showLabel=True,
    ShowTicks=False,
    ShowTooltip=False,
    ShowValLabel=True)
button_2 = CreateButton(ButtonName="戻る", ButtonStyle=0)
textbox = CreateTextBox(DefaultText="name", UpdateButton=False, showLabel=True)
filepicker = CreateFilePicker(ButtonLabelText="browse", DialogType=2, MustExist=True, Filter="All Files|*.*", StartingPath="D:\test")
button_3 = CreateButton(ButtonName="リセット", ButtonStyle=0)
button_4 = CreateButton(ButtonName="曲線を反転", ButtonStyle=0)
checkbox = CreateCheckbox(Label="曲線を反転", StartingValue=False)
stack = CreateStack(UIElements=[button_2, button], Horizontal=True)
startdraw = BooleanToggle(False)
entwine = Entwine(Branch00=slider_2, Branch01=slider, FlattenInputs=True)
entwine_2 = Entwine(
    Branch00=toggle,
    Branch01=checkbox,
    Branch02=stack,
    Branch03=textbox,
    Branch04=filepicker,
    Branch05=button_3,
    FlattenInputs=True)
values = ValueListener(Elements=checkbox, SomeProperty=True)  # -> Values, Indices
values_2 = ValueListener(Elements=button, SomeProperty=True)  # -> Values, Indices
values_3 = ValueListener(Elements=button_2, SomeProperty=True)  # -> Values, Indices
values_4 = ValueListener(Elements=textbox, SomeProperty=True)  # -> Values, Indices
values_5 = ValueListener(Elements=filepicker, SomeProperty=True)  # -> Values, Indices
values_6 = ValueListener(Elements=button_3, SomeProperty=True)  # -> Values, Indices
values_7 = ValueListener(Elements=toggle, SomeProperty=True)  # -> Values, Indices
values_8 = ValueListener(Elements=slider, SomeProperty=True)  # -> Values, Indices
values_9 = ValueListener(Elements=slider_2, SomeProperty=True)  # -> Values, Indices
setslider = SetSlider(UISlider=slider, Value=values_8.Values)
setslider_2 = SetSlider(UISlider=slider_2, Value=values_9.Values)
curvepoint = PointOnCurve(crv, parameter=0.5)
sort_pt = SortPoints(Points=curvepoint)  # -> Points, Indices
concat = Concatenate(FragmentA=values_5.Values, FragmentB="\")
tabs = TabbedView(TabNames=panel, TabTextSize=Slider(20, range=0..100), Tab0=flatten(entwine_2), Tab1=flatten(entwine))
item = ListItem(List=crv, Index=sort_pt.Indices, Wrap=True)
addelems = AddElements(Window=launchwin, Elements=flatten(tabs), DoVLChecking=True)  # -> AddedElements, ElementNames
crv_2 = Curve(item)
lng = ListLength(List=crv_2)
file = ReadFile(File="D:\python\sectiondrawer\sectiondrawer\sectiondrawer.py", PerLineParse=False)
end = EndPoints(Curve=crv_2)  # -> Start, End
series = Series(Start=0, Step=1, Count=lng)
merge = Merge(Data1=graft(end.Start), Data2=graft(end.End))
python = PythonScript(
    Code=file,
    Curve=crv_2,
    Reverse=values.Values,
    Directory=concat,
    Name=values_4.Values,
    Reset=values_6.Values,
    Next=values_2.Values,
    Undo=values_3.Values,
    Draw=values_7.Values,
    Parameter=values_9.Values,
    Mark=values_8.Values)  # -> Out, Direction, Circle
panel_2 = Panel(python.Out)
int = Integer(series)
tag = TextTag3D(Location=merge, Text=graft(int), Size=Slider(1, range=0..10), Justification=7)
